# Grasshopper definition 11A-AppBuilder_Tutorial1.ghx (Grasshopper 1.0.7)
# plug-ins: ShapeDiverForGrasshopper

# ----
# App Builder Tutorial 1:
# Basic App Builder setup with two containers, parameter and text widgets.
# Main algorithm
# Main algorithm: This simple definition creates a parametric twisted tower from three sliders.
# 
# A glTF 2.0 Display component is used to show geometry in the online App.
# 
# A Download Export component is included to let users export the created geometry to 3dm.
# 
# Some numerical data about the created tower is also extracted so we can later display it in the App.
rotation_angle = Slider(45, range=0..180)
floor_height = Slider(10, range=5..15)
# App Builder logic
floor_count = Slider(15, range=0..30)
curve = Curve(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)
cluster = Cluster(curve=curve, num=rotation_angle, num_2=floor_height, int=floor_count)  # -> mesh_3, floorvolume, totalheight
rhino_version = ValueList({"6", "7"}, selected="6")
mesh = Mesh(cluster.mesh_3)
export3dm = _3dmExportOptions(Version=rhino_version)
color = ColourSwatch(SwatchColor=RGB(161, 84, 255))
num = Number(cluster.floorvolume)
num_2 = Number(cluster.totalheight)
gltfdisplay = GlTF20Display(Geometry=mesh, Material=color)
export3dm_2 = DownloadExport(Data=mesh, Options=export3dm, Name="test_export")

# ----
# Text widget: Plain text can be used or markdown for some formatting options
# Build a text widget
panel = Panel("]{color=\"green\"} m:span[3]{style=\"sup\"}")
num_3 = Number(num_2)
int = Integer(num)
concat = Concatenate(FragmentA="Building **total height**: :span[", FragmentB=num_3, FragmentC="]{color=\"blue\"}m")
concat_2 = Concatenate(FragmentA="Individual floor **volume**: :span[", FragmentB=int, FragmentC=panel)
concat_3 = Concatenate(FragmentA="## Building details", FragmentB=concat, FragmentC=concat_2)
panel_2 = Panel(concat_3)
txt = Text(concat_3)
buildtextwidget = BuildTextWidget(Text=txt)

# ----
# Add controls for the
# definition's parameters
# Parameter ordering: Parameters are displayed according to the order of the Controls Widget's input list
panel_3 = Panel("Floor Height")
merge = Merge(Data1=panel_3, Data2="Floor Count")
paramctrl = ParameterControl(Name="Rotation Angle")
paramctrl_2 = ParameterControl(Name=merge)
controlswidget = ControlsWidget(Controls=paramctrl)
controlswidget_2 = ControlsWidget(Controls=paramctrl_2)

# ----
# Build a controls widget
# including an export button
# Controls: Controls Widgets can include and mix together any type of controls (Parameter, Export, Action and Output).
panel_4 = Panel("Rhino Version")
exportctrl = ExportControl(Name="Export3dm")
paramctrl_3 = ParameterControl(Name=panel_4)
merge_2 = Merge(Data1=paramctrl_3, Data2=exportctrl)
controlswidget_3 = ControlsWidget(Controls=merge_2)

textwidget = TextWidget(Text="Play with some floor-specific parameters.")

# ----
# Build tabs from widgets
# Tabs: The name and icon will be displayed in the app (default template).
# 
# The list of available icons is available here: https://help.shapediver.com/doc/build-tab
panel_5 = Panel("Example tooltip 1")
tab = Tab(Name="Details", Icon="info-circle", Tooltip=panel_5, Widgets=buildtextwidget)
tab_2 = Tab(Name="Exports", Icon="arrow-down", Widgets=controlswidget_3)

# ----
# Group widgets
# in an accordion
# Accordion widgets: This example creates a Single Accordion Widget that includes text and some inputs.
# 
# A Multiple Accordion Widget is also available for organizing widgets in separate groups.
panel_6 = Panel("stack-middle")
merge_3 = Merge(Data1=textwidget, Data2=controlswidget_2)
singleaccordion = SingleAccordionWidget(Label="Floor inputs", Icon=panel_6, Widgets=merge_3)

# ----
# Build containers from
# tabs and/or widgets
# Containers: In the default template, four container names can be used: top, left, right and bottom.
# 
# Use widgets directly if your container does not need to be split into tabs.
merge_4 = Merge(Data1=controlswidget, Data2=singleaccordion)
merge_5 = Merge(Data1=flatten(tab), Data2=flatten(tab_2))
buildcontainer = BuildContainer(Name="left", Widgets=merge_4)
buildcontainer_2 = BuildContainer(Name="right", Tabs=merge_5)

# ----
# Build an app
# from containers
merge_6 = Merge(Data1=buildcontainer, Data2=buildcontainer_2)
app = App(Containers=merge_6)

# ==== cluster Cluster
curve = ClusterInput()
num = ClusterInput()
num_2 = ClusterInput()
int = ClusterInput()
curve_2 = Curve(curve)
num_3 = Number(num)
num_4 = Number(num_2)
int_2 = Integer(int)
x_minus_one = XMinusOne(NumberX=int_2)
series = Series(Start=0, Step=num_4, Count=int_2)
division = Division(A=num_3, B=x_minus_one)
series_2 = Series(Start=0, Step=division, Count=int_2)
vec = VectorXYZ(XComponent=0, YComponent=0, ZComponent=series)  # -> Vector, Length
rad = Radians(Degrees=series_2)
move = Move(Geometry=curve_2, Motion=vec.Vector)  # -> Geometry, Transform
rotate = Rotate(Geometry=move.Geometry, Angle=rad, Plane=PlaneXY(0, 0, 0))  # -> Geometry, Transform
vec_2 = VectorXYZ(XComponent=0, YComponent=0, ZComponent=num_4)  # -> Vector, Length
extr = Extrude(Base=rotate.Geometry, Direction=vec_2.Vector)
cap = CapHoles(Brep=extr)
jagged = SettingsSpeed()
mesh = MeshBrep(Brep=cap, Settings=jagged)
multiplication = Multiplication(A=num_4, B=int_2)
item = ListItem(List=mesh, Index=0, Wrap=True)
volume = Volume(Geometry=item)  # -> Volume, Centroid
mesh_2 = Mesh(mesh)
num_5 = Number(multiplication)
mesh_3 = ClusterOutput(mesh_2)
num_6 = Number(volume.Volume)
totalheight = ClusterOutput(num_5)
floorvolume = ClusterOutput(num_6)
