# Grasshopper definition 11G-AccordionAndStackWidgets.ghx (Grasshopper 1.0.7)
# plug-ins: ShapeDiverForGrasshopper

merge = Merge(Data1="Radius", Data2="Color")
paramctrl = ParameterControl(Name=merge)
controlswidget = ControlsWidget(Controls=paramctrl)
singleaccordion = SingleAccordionWidget(Label="Accordion", Icon="adjustments-horizontal", AppBuilderWidgets=controlswidget)
stack = StackWidget(Label="Stack", Icon="adjustments-horizontal", AppBuilderWidgets=controlswidget)
merge_2 = Merge(Data1=singleaccordion, Data2=stack)  # -> flatten(Result)
container = Container(Location="right", AppBuilderWidgets=merge_2)
merge_3 = Merge(Data2=container)
app = App(AppBuilderContainer=merge_3)

radius = Slider(1, range=0..1)
color = ColourSwatch(SwatchColor=RGB(255, 0, 0))
msphere = MeshSphere(Base=PlaneXY(0, 0, 0), Radius=radius, UCount=10, VCount=20)
gltfdisplay = GlTF20Display(Geometry=msphere, Material=color)
