# Grasshopper definition BETA-DynamicValueListsTutorial.ghx (Grasshopper 1.0.8)
# plug-ins: jSwan, ShapeDiverForGrasshopper

foodtype = ValueList({"Fruits": 0, "Vegetables": 1, "Meat": 2}, selected="Fruits")

# ----
# Test data
panel = Panel("2")
rejson = SerializeJson(VegetablesList=panel, FruitsList="1", IncludeNullAndEmptyProperties=False)

appbuilder = DirectTextInput(maxlength=10000, text="Default")
parsejson = ParseJSON(JSON=appbuilder)
txt = Text(["Fruits", "Vegetables", "Meat"])
accessjson = AccessJSON(Object=parsejson, AddressString="FruitsList")
accessjson_2 = AccessJSON(Object=parsejson, AddressString="VegetablesList")
accessjson_3 = AccessJSON(Object=parsejson, AddressString="MeatList")
txt_2 = Text(["Bananas", "Strawberries", "Apricots"])
txt_3 = Text(["Broccoli", "Artichokes", "Cucumbers"])
txt_4 = Text(["Chicken", "Beef", "Lamb"])
item = ListItem(List=txt, Index=foodtype, Wrap=True)
filter = StreamFilter(Gate=foodtype, Stream0=txt_2, Stream1=txt_3, Stream2=txt_4)
filter_2 = StreamFilter(Gate=foodtype, Stream0="0", Stream1="1", Stream2="2")
filter_3 = StreamFilter(Gate=foodtype, Stream0=accessjson, Stream1=accessjson_2, Stream2=accessjson_3)
concat = Concatenate(FragmentA=item, FragmentB="List")
null = NullItem(Item=filter_3)  # -> NullFlags, InvalidFlags, Description
filter_4 = StreamFilter(Gate=null.NullFlags, Stream0=filter_3, Stream1=filter_2)
item_2 = ListItem(List=filter, Index=filter_4, Wrap=True)
rejson_2 = SerializeJson(
    Name=concat,
    Id=concat,
    Type="StringList",
    Visualization="dropdown",
    Choices=filter,
    Defval=filter_2,
    Value=filter_4,
    IncludeNullAndEmptyProperties=False)
pt = Point(Point(0, 0, 0))
paramctrl = ParameterControl(Name="FoodType")
paramctrl_2 = ParameterControl(Name=concat, SessionId="default_appbuilder")
tag = TextTag3D(Location=pt, Text=item_2, Size=1, Justification=7)
txt_5 = Text(rejson_2)
merge = Merge(Data1=paramctrl, Data2=paramctrl_2)
controlswidget = ControlsWidget(Controls=merge)
container = Container(Name="right", Widgets=controlswidget)
panel_2 = Panel(txt_5)
app = App(Containers=container, Parameters=txt_5)
